# Grasshopper definition InfillOpt.gh (Grasshopper 1.0.7)
# plug-ins: Anemone, GH_CPython

# ---- group: Load settings
normal_force = BooleanToggle(True)
friction_force = BooleanToggle(False)
force_falloff = Slider(1, range=1..10)
# Adding custom load settings: To add unique settings for each load, copy the loading conditions group and connect the additional wires to the InfillOpt object
distribution = Slider(0, range=0..1)

# ---- group: Solve
reset = Button()
solve = Button()
# Tutorial: 1. Set a flat surface as the shape. This is the design space in which the optimized geometry will be generated.
# 
# 2. Set lines with one end point touching an edge of the surface as the loads. You can set up to three loads. You can choose how the loads are distributed using the load settings panel.
# 
# 3. Set boundary conditions; these can be edges of the surface or any line or curve that overlaps an edge of the design space.
# 
# 4. Adjust pixel density, shell thickness and optimization objectives.
# 
# 5. By default, previews of the shell, loads and boundary conditions are shown. These can be disabled if desired.
# 
# 6. Press solve and watch the solution generate in real time. Please be patient, the algorithm can take some time.
stop = Button()

# ---- group: Geometry
boundaries = Curve(<curve referenced from the Rhino model>)
forces = Curve(<curve referenced from the Rhino model>)
shape = Surface(<surface referenced from the Rhino model>)

# ---- group: Preview
preview_loads = BooleanToggle(True)
preview_shell = BooleanToggle(True)
preview_bc_s = BooleanToggle(True)

# ---- group: Settings
min_volume = Slider(0.4, range=0.1..1)
shell_thickness = Slider(0.2, range=0.1..2)
max_volume = Slider(0.6, range=0.1..1)
pixel_density = Slider(40, range=0..500)

# ---- group: Load settings
normal_force_2 = BooleanToggle(True)  # disabled
friction_force_2 = BooleanToggle(True)  # disabled
force_falloff_2 = Slider(20, range=1..50)  # disabled
distribution_2 = Slider(1, range=0..1)  # disabled

# ---- group: Objectives
global_density = BooleanToggle(False)
local_density = BooleanToggle(True)

# ---- group: Load settings
normal_force_3 = BooleanToggle(True)  # disabled
friction_force_3 = BooleanToggle(True)  # disabled
distribution_3 = Slider(1, range=0..1)  # disabled
force_falloff_3 = Slider(8, range=1..10)  # disabled

# ----
infillopt = InfillOpt(
    shape=shape,
    forces=forces,
    boundaries=boundaries,
    shell_thickness=shell_thickness,
    x=pixel_density,
    global=global_density,
    local=local_density,
    vol_max=max_volume,
    vol_min=min_volume,
    falloff_values=[force_falloff, force_falloff_3, force_falloff_2],
    normal_toggle=[normal_force, normal_force_2, normal_force_3],
    friction_toggle=[friction_force, friction_force_2, friction_force_3],
    distributions=[distribution, distribution_2, distribution_3],
    preview_shell=preview_shell,
    preview_forces=preview_loads,
    preview_bc_s=preview_bc_s,
    solve=solve,
    reset=reset,
    stop=stop)

# ---- group: Display results
gate_or = GateOr(A=reset, B=stop)
or = GateOr(A=solve, B=Button())
loop_start = LoopStart(Repeat=10000, Trigger=or, Reset=gate_or)  # -> port, Counter, Reset
fetch_results = FetchResults(reset=loop_start.Reset)  # -> output, done; inputs reset: list
# ---------- fetch_results: Python ----------
# -*- coding: utf-8 -*-
""" 
Python Script
Created on  Thursday September 2017 07:47:01 
@author:  egarner 

[desc]
Description of the plugin Here
Write here any thing... 
[/desc]

ARGUMENTS:
----------
<inp> 
    _input :[required] - [type = int] - [default = None] 
    Descripe your input here 
        * bullet point.
        * bullet point
</inp>
<inp>
    Other inputs go here ...
</inp>

RETURN:
----------
    <out>
        output_ : indicate your output description here. \n refers to a new line.
    </out>

"""

import os
import scipy.io as spio
import numpy as np

os.chdir("H:\www\data\InfillOpt\output")

mat = spio.loadmat('result_data.mat', squeeze_me=True)
output_ = np.around(mat['xPhys_flipped'],decimals=1)
output_ = output_.tolist()
done = mat['done']

os.chdir("H:\www\data\InfillOpt")
reset_file = spio.loadmat('reset_data.mat')
reset = reset_file['reset_flag'][0]
stop = reset_file['stop_flag'][0]


if reset or mat['done'] or stop:
    done = 1

if reset:
    output_= 0
# ---------- end fetch_results ----------
results = Results(G=infillopt, P=fetch_results.done, x=fetch_results.output, S=shape)
running = Running(
    port=loop_start.port,
    Exit=fetch_results.done,
    Reset=loop_start.Reset,
    TimeOutVal=0,
    pausedState=False,
    state="Constant output")
gh_cpython = GH_CPython(input=fetch_results.output, i=loop_start.Counter)  # -> output; inputs input: list, i: list
# ---------- gh_cpython: Python ----------
# -*- coding: utf-8 -*-
""" 
Python Script
Created on  Wednesday September 2017 02:57:12 
@author:  egarner 

[desc]
Description of the plugin Here
Write here any thing... 
[/desc]

ARGUMENTS:
----------
<inp> 
    _input :[required] - [type = int] - [default = None] 
    Descripe your input here 
        * bullet point.
        * bullet point
</inp>
<inp>
    Other inputs go here ...
</inp>

RETURN:
----------
    <out>
        output_ : indicate your output description here. \n refers to a new line.
    </out>

"""

import numpy as np
import matplotlib.pyplot as plt
import os

os.chdir("C:\Users\egarner\desktop\InfillOpt\output")

data = np.transpose(_input)
img = plt.imshow(data, cmap='gray_r')
plt.axis('off')
name = str(i)
plt.savefig(name, bbox_inches='tight')
# ---------- end gh_cpython ----------

# ==== cluster Results
x = ClusterInput()
P = ClusterInput()
totree = PythonScript(x=x)  # -> a
# ---------- totree: Python ----------
def list_to_tree(input, none_and_holes=True, base_path=[0]):
    """Transforms nestings of lists or tuples to a Grasshopper DataTree"""
    from Grasshopper import DataTree as Tree
    from Grasshopper.Kernel.Data import GH_Path as Path
    from System import Array
    def process_one_item(input,tree,track):
        path = Path(Array[int](track))
        if len(input) == 0 and none_and_holes: tree.EnsurePath(path); return
        for i,item in enumerate(input):
            if hasattr(item, '__iter__'): #if list or tuple
                track.append(i); process_one_item(item,tree,track); track.pop()
            else:
                if none_and_holes: tree.Insert(item,path,i)
                elif item is not None: tree.Add(item,path)
    tree = Tree[object]()
    if input is not None: process_one_item(input,tree,base_path[:]); return tree
    
mytree = eval(x)

a = list_to_tree(mytree)
# ---------- end totree ----------
not = GateNot(A=P)
round = Round(Number=totree)  # -> Nearest, Floor, Ceiling
G = ClusterInput()
dispatch = Dispatch(List=round.Nearest, DispatchPattern=P)  # -> ListA, ListB
dispatch_2 = Dispatch(List=totree, DispatchPattern=not)  # -> ListA, ListB
one_over_x = OneOverX(Value="11")
dispatch_3 = Dispatch(List=G, DispatchPattern=dispatch.ListA)  # -> ListA, ListB
series = Series(Start=0, Step=one_over_x, Count="11")
multiplication = Multiplication(A=dispatch_2.ListA, B=10)
mjoin = MeshJoin(Meshes=flatten(dispatch_3.ListA))
blendcol = BlendColours(ColourA=RGBA(255, 255, 255, 0), ColourB=RGB(0, 0, 0), Factor=series)
weld = WeldMesh(Mesh=mjoin, Angle=3.141592654)
item = ListItem(List=blendcol, Index=multiplication, Wrap=True)
wblaplace = WeaverbirdsLaplacianSmoothing(MeshCurves=weld, Level=1, SmoothNakedEdges=1, Thin=1)
preview = CustomPreview(Geometry=G, Shader=item)
medges = MeshEdges(Mesh=wblaplace)  # -> NakedEdges, InteriorEdges, NonManifoldEdges
join = JoinCurves(Curves=medges.NakedEdges, Preserve=False)  # -> graft(Curves)
cx = CurveSelf(Curve=join)  # -> Points, Params
lng = ListLength(List=cx.Params)
equals = Equality(FirstNumber=lng, SecondNumber=0)  # -> Equality, Inequality
shatter = Shatter(Curve=join, Parameters=cx.Params)  # -> flatten(Segments)
dispatch_4 = Dispatch(List=join, DispatchPattern=equals.Equality)  # -> flatten(ListA), ListB
merge = Merge(Data1=shatter, Data2=dispatch_4.ListA)
explode = Explode(Curve=merge, Recursive=True)  # -> Segments, Vertices
nurbs = NurbsCurve(Vertices=explode.Vertices, Degree=3, Periodic=False)  # -> flatten(Curve), Length, Domain
len = Length(Curve=nurbs.Curve)
sort = SortList(Keys=len, ValuesA=nurbs.Curve)  # -> Keys, ValuesA
cull_i = CullIndex(List=sort.ValuesA, Indices=-1, Wrap=True)
S = ClusterInput()
cls = Closed(Curve=cull_i)  # -> Closed, Periodic
dispatch_5 = Dispatch(List=cull_i, DispatchPattern=cls.Closed)  # -> ListA, ListB
srfsplit = SurfaceSplit(Surface=S, Curves=dispatch_5.ListA)
item_2 = ListItem(List=srfsplit, Index=0, Wrap=True)
i = ClusterOutput(item_2)

# ==== cluster InfillOpt
shape = ClusterInput()
forces = ClusterInput()
boundaries = ClusterInput()
shell_thickness = ClusterInput()
x = ClusterInput()
global = ClusterInput()
local = ClusterInput()
vol_max = ClusterInput()
vol_min = ClusterInput()
falloff_values = ClusterInput()
normal_toggle = ClusterInput()
friction_toggle = ClusterInput()
distributions = ClusterInput()
preview_shell = ClusterInput()
preview_forces = ClusterInput()
preview_bc_s = ClusterInput()
solve = ClusterInput()
reset = ClusterInput()
stop = ClusterInput()
evaluate = Evaluate(Expression="1/sqrt(x)", x=x)
build_grid = BuildGrid(shape=shape, resolution=evaluate, P=preview_shell, shell_thk=shell_thickness)  # -> mesh_2, nodes, void, solid, nelx, nely
set_bc_s = SetBCs(nodes=build_grid.nodes, boundaries=boundaries, resolution=evaluate, P=preview_bc_s)
set_loads = SetLoads(
    nodes=build_grid.nodes,
    shape=shape,
    resolution=evaluate,
    forces=forces,
    falloff_values=falloff_values,
    normal_forces=normal_toggle,
    friction_forces=friction_toggle,
    distributions=distributions,
    A=preview_forces)  # -> R, R_2, r_2, r
set_objective = SetObjective(d1=global, d3=local)
mesh = ClusterOutput(build_grid.mesh_2)
sovle = Sovle(
    solve=solve,
    mdof=set_objective,
    vol_max=vol_max,
    vol_min=vol_min,
    nelx=build_grid.nelx,
    nely=build_grid.nely,
    bVoid=build_grid.void,
    bSolid=build_grid.solid,
    Fx_ind=set_loads.r_2,
    Fy_ind=set_loads.r,
    Fx=set_loads.R,
    Fy=set_loads.R_2,
    fixeddofs=set_bc_s,
    reset=reset,
    stop=stop)  # inputs solve: list, mdof: list, vol_max: list, vol_min: list, nelx: list, nely: list, bVoid: list, bSolid: list, Fx_ind: list, Fy_ind: list, Fx: list, Fy: list, fixeddofs: list, reset: list, stop: list
# ---------- sovle: Python ----------
# -*- coding: utf-8 -*-
""" 
Python Script
Created on  Thursday September 2017 07:39:26 
@author:  egarner 

[desc]
Description of the plugin Here
Write here any thing... 
[/desc]

ARGUMENTS:
----------
<inp> 
    _input :[required] - [type = int] - [default = None] 
    Descripe your input here 
        * bullet point.
        * bullet point
</inp>
<inp>
    Other inputs go here ...
</inp>

RETURN:
----------
    <out>
        output_ : indicate your output description here. \n refers to a new line.
    </out>

"""
import numpy as np
import os
import sys
import scipy.io as spio



os.chdir("C:\Users\egarner\desktop\InfillOpt")

if solve == True:
    solve_flag = 1
    reset_flag = 0
    stop_flag = 0
    spio.savemat('user_data.mat',  dict(nelx = nelx, nely = nely, mdof = mdof, bVoid = bVoid, bSolid = bSolid, vol_max = vol_max, vol_min = vol_min, Fx_ind = Fx_ind, Fy_ind = Fy_ind, Fx = Fx, Fy = Fy, fixeddofs = fixeddofs))
    spio.savemat('reset_data.mat', dict(solve_flag = solve_flag, reset_flag = reset_flag, stop_flag = stop_flag))
    



elif reset == True:
    reset_flag = 1
    stop_flag = 0
    xPhys_flipped = 0
    done = 0
    spio.savemat('reset_data.mat', dict(reset_flag = reset_flag, stop_flag = stop_flag))
    spio.savemat('result_data.mat', dict(xPhys_flipped = xPhys_flipped, done = done))

elif stop == True:
    stop_flag = 1
    reset_flag = 0
    spio.savemat('reset_data.mat', dict(reset_flag = reset_flag, stop_flag = stop_flag))

else:
    pass
# ---------- end sovle ----------

# ==== cluster BuildGrid
resolution = ClusterInput()
shape = ClusterInput()
resolution_2 = Number(resolution)
shape_2 = Surface(shape)
bbox = BoundingBox(Content=shape_2, Plane=PlaneXY(0, 0, 0))  # -> Box, Box_2
debox = DeconstructBox(Box=bbox.Box)  # -> Plane, X, Y, Z
dedomain = DeconstructDomain(Domain=debox.X)  # -> Start, End
dedomain_2 = DeconstructDomain(Domain=debox.Y)  # -> Start, End
pt = ConstructPoint(XCoordinate=dedomain.Start, YCoordinate=dedomain_2.Start, ZCoordinate=0)
subtraction = Subtraction(A=dedomain.End, B=dedomain.Start)
subtraction_2 = Subtraction(A=dedomain_2.End, B=dedomain_2.Start)
debrep = DeconstructBrep(Brep=shape_2)  # -> Faces, Edges, Vertices
area = Area(Geometry=debrep.Faces)  # -> Area, Centroid
join = JoinCurves(Curves=debrep.Edges, Preserve=False)
round = Round(Number=subtraction)  # -> Nearest, Floor, Ceiling
round_2 = Round(Number=subtraction_2)  # -> Nearest, Floor, Ceiling
shell_thk = ClusterInput()
pl_origin = PlaneOrigin(Base=PlaneXY(0, 0, 0), Origin=area.Centroid)
one_over_x = OneOverX(Value=resolution_2)
multiplication = Multiplication(A=round.Ceiling, B=one_over_x)
multiplication_2 = Multiplication(A=one_over_x, B=round_2.Ceiling)
offset = Offset(Curve=join, ShellThk=shell_thk, Plane=pl_origin, Corners=1)  # -> flatten(Curve)
offset_2 = Offset(Curve=join, ShellThk=expr("-x", shell_thk), Plane=pl_origin, Corners=1)  # -> simplify(Curve)
round_3 = Round(Number=multiplication)  # -> Nearest, Floor, Ceiling
round_4 = Round(Number=multiplication_2)  # -> Nearest, Floor, Ceiling
nelx = ClusterOutput(round_3.Ceiling)
nely = ClusterOutput(round_4.Ceiling)
sqgrid = Square(Plane=pt, Size=resolution_2, ExtentX=round_3.Ceiling, ExtentY=round_4.Ceiling)  # -> reverse(Cells), reverse(flatten(Points))
boundary = BoundarySurfaces(Edges=offset)
boundary_2 = BoundarySurfaces(Edges=offset_2)
area_2 = Area(Geometry=boundary)  # -> Area, Centroid
area_3 = Area(Geometry=shape_2)  # -> Area, Centroid
nodes = ClusterOutput(sqgrid.Points)
path_mapper = PathMapper(sqgrid.Cells, source="{0;0;0;0}", target="{0;path_index}")
pcen = PolygonCenter(Polyline=path_mapper)  # -> CenterV, CenterE, CenterA
srf_cp = SurfaceClosestPoint(Point=pcen.CenterV, Surface=shape_2)  # -> Point, UVPoint, Distance
smaller = SmallerThan(FirstNumber=area_2.Area, SecondNumber=area_3.Area)  # -> SmallerThan, OrEqualTo
smaller_2 = SmallerThan(FirstNumber=srf_cp.Distance, SecondNumber=0.001)  # -> SmallerThan, OrEqualTo
filter = StreamFilter(Gate=smaller.SmallerThan, Stream0=boundary_2, Stream1=boundary)
srf_cp_2 = SurfaceClosestPoint(Point=pcen.CenterV, Surface=filter)  # -> Point, UVPoint, Distance
smaller_3 = SmallerThan(FirstNumber=srf_cp_2.Distance, SecondNumber=0.001)  # -> SmallerThan, OrEqualTo
not = GateNot(A=smaller_2.SmallerThan)  # -> simplify(Result)
subtraction_3 = Subtraction(A=smaller_2.SmallerThan, B=smaller_3.SmallerThan)  # -> simplify(Result)
path_mapper_2 = PathMapper(not, source="{path_ind}", target="{0;path_ind}")
path_mapper_3 = PathMapper(subtraction_3, source="{path_ind}", target="{0;path_ind}")
mesh = Mesh(path_mapper)
tolist = PythonScript(x=path_mapper_3)  # -> solid; inputs x: tree
# ---------- tolist: Python ----------
# written by Giulio Piacentino, giulio@mcneel.com
def tree_to_list(input, retrieve_base = lambda x: x[0]):
    """Returns a list representation of a Grasshopper DataTree"""
    def extend_at(path, index, simple_input, rest_list):
        target = path[index]
        if len(rest_list) <= target: rest_list.extend([None]*(target-len(rest_list)+1))
        if index == path.Length - 1:
            rest_list[target] = list(simple_input)
        else:
            if rest_list[target] is None: rest_list[target] = []
            extend_at(path, index+1, simple_input, rest_list[target])
    all = []
    for i in range(input.BranchCount):
        path = input.Path(i)
        extend_at(path, 0, input.Branch(path), all)
    return retrieve_base(all)

solid = repr( tree_to_list(x) )
# ---------- end tolist ----------
tolist_2 = PythonScript(x=path_mapper_2)  # -> void; inputs x: tree
# ---------- tolist_2: Python ----------
# written by Giulio Piacentino, giulio@mcneel.com
def tree_to_list(input, retrieve_base = lambda x: x[0]):
    """Returns a list representation of a Grasshopper DataTree"""
    def extend_at(path, index, simple_input, rest_list):
        target = path[index]
        if len(rest_list) <= target: rest_list.extend([None]*(target-len(rest_list)+1))
        if index == path.Length - 1:
            rest_list[target] = list(simple_input)
        else:
            if rest_list[target] is None: rest_list[target] = []
            extend_at(path, index+1, simple_input, rest_list[target])
    all = []
    for i in range(input.BranchCount):
        path = input.Path(i)
        extend_at(path, 0, input.Branch(path), all)
    return retrieve_base(all)

void = repr( tree_to_list(x) )
# ---------- end tolist_2 ----------
mesh_2 = ClusterOutput(mesh)
solid = ClusterOutput(tolist)
void = ClusterOutput(tolist_2)
dispatch = Dispatch(List=mesh, DispatchPattern=subtraction_3)  # -> ListA, ListB
P = ClusterInput()
dispatch_2 = Dispatch(List=dispatch.ListA, DispatchPattern=P)  # -> ListA, ListB
preview = CustomPreview(Geometry=dispatch_2.ListA, Shader=ColourSwatch(SwatchColor=RGB(0, 0, 0)))

# ==== cluster SetObjective
d3 = ClusterInput()
d1 = ClusterInput()
merge = Merge(Data1=d1, Data2=Toggle(False), Data3=d3)
index = ItemIndex(List=merge, Item=merge)  # -> expr("x+1", Index)
multiplication = Multiplication(A=merge, B=index)
dispatch = Dispatch(List=multiplication, DispatchPattern=merge)  # -> ListA, ListB
tolist = PythonScript(x=dispatch.ListA)  # -> a; inputs x: tree
# ---------- tolist: Python ----------
# written by Giulio Piacentino, giulio@mcneel.com
def tree_to_list(input, retrieve_base = lambda x: x[0]):
    """Returns a list representation of a Grasshopper DataTree"""
    def extend_at(path, index, simple_input, rest_list):
        target = path[index]
        if len(rest_list) <= target: rest_list.extend([None]*(target-len(rest_list)+1))
        if index == path.Length - 1:
            rest_list[target] = list(simple_input)
        else:
            if rest_list[target] is None: rest_list[target] = []
            extend_at(path, index+1, simple_input, rest_list[target])
    all = []
    for i in range(input.BranchCount):
        path = input.Path(i)
        extend_at(path, 0, input.Branch(path), all)
    return retrieve_base(all)

a = repr( tree_to_list(x) )
# ---------- end tolist ----------
a = ClusterOutput(tolist)

# ==== cluster SetBCs
resolution = ClusterInput()
boundaries = ClusterInput()
resolution_2 = Number(resolution)
boundaries_2 = Curve(boundaries)
nodes = ClusterInput()
nodes_2 = Point(nodes)
crv_cp = CurveClosestPoint(Point=nodes_2, Curve=graft(boundaries_2))  # -> Point, Parameter, Distance
smaller = SmallerThan(FirstNumber=crv_cp.Distance, SecondNumber=expr("x/2", resolution_2))  # -> SmallerThan, OrEqualTo
dispatch = Dispatch(List=nodes_2, DispatchPattern=smaller.SmallerThan)  # -> ListA, ListB
crv_cp_2 = CurveClosestPoint(Point=dispatch.ListA, Curve=graft(boundaries_2))  # -> Point, Parameter, Distance
index = ItemIndex(List=nodes_2, Item=dispatch.ListA)
P = ClusterInput()
dispatch_2 = Dispatch(List=crv_cp_2.Point, DispatchPattern=P)  # -> ListA, ListB
eval = Evaluate(F="2*x + 2", x=index)
eval_2 = Evaluate(F="2*x + 1", x=index)
cloud = CloudDisplay(Points=dispatch_2.ListA, Colours=RGB(255, 0, 0), Size=expr("x*1.5", resolution_2), SpriteType=0)
xfixeddof = Number(eval_2)
yfixeddof = Number(eval)
dispatch_3 = Dispatch(List=yfixeddof, DispatchPattern=invert([True, False]))  # -> ListA, ListB
dispatch_4 = Dispatch(List=xfixeddof, DispatchPattern=invert([True, False]))  # -> ListA, ListB
merge = Merge(Data1=dispatch_4.ListA, Data2=dispatch_3.ListA)  # -> flatten(Result)
R = ClusterOutput(merge)

# ==== cluster SetLoads
forces = ClusterInput()
resolution = ClusterInput()
falloff_values = ClusterInput()
nodes = ClusterInput()
shape = ClusterInput()
forces_2 = Curve(forces)
resolution_2 = Number(resolution)
normal_forces = ClusterInput()
nodes_2 = Point(nodes)
shape_2 = Surface(shape)
falloff_values_2 = Number(falloff_values)
friction_forces = ClusterInput()
debrep = DeconstructBrep(Brep=shape_2)  # -> Faces, Edges, Vertices
end = EndPoints(Curve=forces_2)  # -> Start, End
normal_forces_2 = Boolean(normal_forces)
friction_forces_2 = Boolean(friction_forces)
join = JoinCurves(Curves=debrep.Edges, Preserve=False)  # -> reparameterize(Curves)
crv_cp = CurveClosestPoint(Point=graft(end.End), Curve=join)  # -> Point, Parameter, Distance
crv_cp_2 = CurveClosestPoint(Point=nodes_2, Curve=graft(join))  # -> Point, Parameter, Distance
smaller = SmallerThan(FirstNumber=crv_cp.Distance, SecondNumber=0.1)  # -> SmallerThan, OrEqualTo
smaller_2 = SmallerThan(FirstNumber=crv_cp_2.Distance, SecondNumber=expr("x*0.5", resolution_2))  # -> SmallerThan, OrEqualTo
dispatch = Dispatch(List=join, DispatchPattern=smaller.SmallerThan)  # -> ListA, ListB
dispatch_2 = Dispatch(List=nodes_2, DispatchPattern=smaller_2.SmallerThan)  # -> ListA, ListB
index = ItemIndex(List=join, Item=dispatch.ListA)
A = ClusterInput()
tstat = TreeStatistics(Tree=dispatch_2.ListA)  # -> Paths, Length, Count
crv_cp_3 = CurveClosestPoint(Point=graft(end.End), Curve=dispatch.ListA)  # -> Point, Parameter, Distance
eval = EvaluateCurve(Curve=dispatch.ListA, Parameter=crv_cp_3.Parameter)  # -> Point, Tangent, Angle
division = Division(A=falloff_values_2, B=resolution_2)
item = ListItem(List=tstat.Paths, Index=index, Wrap=True)
curvature = Curvature(Curve=dispatch.ListA, Parameter=crv_cp_3.Parameter)  # -> P, K, C; disabled
and = GateAnd(A=graft(friction_forces_2), B=A)
pframe = PerpFrame(Curve=dispatch.ListA, Parameter=crv_cp_3.Parameter)
branch = TreeBranch(Tree=dispatch_2.ListA, Path=item, MaintainPaths=True)
number_slider = Slider(1, range=0..1)
line = Line(forces_2)
dprod = DotProduct(VectorA=graft(line), VectorB=eval.Tangent, Unitize=False)
multiplication = Multiplication(A=eval.Tangent, B=dprod)
deplane = DeconstructPlane(Plane=pframe)  # -> Origin, XAxis, YAxis, ZAxis
devec = DeconstructVector(Vector=deplane.XAxis)  # -> XComponent, YComponent, ZComponent
cullpt = CullDuplicates(Points=branch, Tolerance=0.1, CullMode=3)  # -> flatten(Points), Indices, Valence
cps = ClosestPoints(Point=end.End, Cloud=cullpt.Points, Count=division)  # -> ClosestPoint, CPIndex, Distance
crossref = CrossReference(ListA=cps.ClosestPoint, ListB=cps.ClosestPoint, CrossMode=1)  # -> ListA, ListB
equals = Equality(FirstNumber=devec.ZComponent, SecondNumber=0)  # -> Equality, Inequality
equals_2 = Equality(FirstNumber=devec.YComponent, SecondNumber=0)  # -> Equality, Inequality
move = Move(Geometry=eval.Point, Motion=expr("-x", multiplication))  # -> Geometry, Transform
cps_2 = ClosestPoints(Point=cps.ClosestPoint, Cloud=nodes_2, Count=1)  # -> ClosestPoint, CPIndex, Distance
dist = Distance(PointA=crossref.ListA, PointB=crossref.ListB)
dispatch_3 = Dispatch(List=deplane.XAxis, DispatchPattern=equals.Equality)  # -> ListA, ListB
dispatch_4 = Dispatch(List=deplane.YAxis, DispatchPattern=equals_2.Equality)  # -> ListA, ListB
eval_2 = Evaluate(F="2*x + 2", x=cps_2.CPIndex)  # -> flatten(r)
eval_3 = Evaluate(F="2*x + 1", x=cps_2.CPIndex)  # -> flatten(r)
dispatch_5 = Dispatch(List=move.Geometry, DispatchPattern=and)  # -> ListA, ListB
sort = SortList(Keys=dist, ValuesA=crossref.ListA, ValuesB=crossref.ListB)  # -> Keys, ValuesA, ValuesB
merge = Merge(Data1=dispatch_4.ListA, Data2=dispatch_3.ListA)
dprod_2 = DotProduct(VectorA=graft(line), VectorB=merge, Unitize=False)
abs = Absolute(Value=dprod_2)
tstat_2 = TreeStatistics(Tree=abs)  # -> Paths, Length, Count
r = ClusterOutput(eval_2)
r_2 = ClusterOutput(eval_3)
item_2 = ListItem(List=sort.ValuesA, Index=-1, Wrap=True)
item_3 = ListItem(List=sort.ValuesB, Index=-1, Wrap=True)
crv_cp_4 = CurveClosestPoint(Point=cps.ClosestPoint, Curve=dispatch.ListA)  # -> Point, Parameter, Distance
vdis = VectorDisplay(Anchor=dispatch_5.ListA, Vector=multiplication)
crv_cp_5 = CurveClosestPoint(Point=[item_2, item_3], Curve=dispatch.ListA)  # -> Point, Parameter, Distance
item_4 = ListItem(List=tstat_2.Paths, Index=0, Wrap=False)
item_5 = ListItem(List=tstat_2.Paths, Index=1, Wrap=False)
item_6 = ListItem(List=tstat_2.Paths, Index=2, Wrap=False)
pframe_2 = PerpFrame(Curve=dispatch.ListA, Parameter=crv_cp_4.Parameter)
deplane_2 = DeconstructPlane(Plane=pframe_2)  # -> Origin, XAxis, YAxis, ZAxis
item_7 = ListItem(List=crv_cp_5.Parameter, Index=0, Wrap=True)
item_8 = ListItem(List=crv_cp_5.Parameter, Index=1, Wrap=True)
branch_2 = TreeBranch(Tree=abs, Path=item_4, MaintainPaths=True)
branch_3 = TreeBranch(Tree=abs, Path=item_5, MaintainPaths=True)
branch_4 = TreeBranch(Tree=abs, Path=item_6, MaintainPaths=True)
dom = ConstructDomain(DomainStart=item_7, DomainEnd=item_8)
merge_2 = Merge(Data1=branch_2, Data2=branch_3, Data3=branch_4)
distributions = ClusterInput()
eval_4 = EvaluateCurve(Curve=dispatch.ListA, Parameter=crv_cp_4.Parameter)  # -> Point, Tangent, Angle
line_2 = LineSDL(Start=deplane_2.Origin, Direction=deplane_2.XAxis, Length=deplane_2.XAxis)
lend = LengthDomain(Curve=dispatch.ListA, Domain=dom)
end_2 = EndPoints(Curve=line_2)  # -> Start, End
eval_5 = Evaluate(F="2*abs(x)", x=lend)
distributions_2 = Number(distributions)
multiplication_2 = Multiplication(A=eval_4.Tangent, B=dprod)
range = Range(Domain=dom, Steps=expr(".75*x + 1", eval_5))
dispatch_6 = Dispatch(List=multiplication_2, DispatchPattern=graft(friction_forces_2))  # -> ListA, ListB
pframe_3 = PerpFrame(Curve=dispatch.ListA, Parameter=range)
deplane_3 = DeconstructPlane(Plane=pframe_3)  # -> Origin, XAxis, YAxis, ZAxis
multiplication_3 = Multiplication(A=dispatch_6.ListB, B=0)
dist_2 = Distance(PointA=deplane_3.Origin, PointB=graft(end.End))
number_slider_2 = Slider(1, range=0..1)
devec_2 = DeconstructVector(Vector=deplane_3.XAxis)  # -> XComponent, YComponent, ZComponent
equals_3 = Equality(FirstNumber=devec_2.ZComponent, SecondNumber=0)  # -> Equality, Inequality
equals_4 = Equality(FirstNumber=devec_2.YComponent, SecondNumber=0)  # -> Equality, Inequality
sort_2 = SortList(Keys=dist_2)  # -> Keys, ValuesA
dist_3 = Distance(PointA=deplane_2.Origin, PointB=graft(end.End))
item_9 = ListItem(List=sort_2.Keys, Index=-1, Wrap=True)
dispatch_7 = Dispatch(List=deplane_3.XAxis, DispatchPattern=equals_3.Equality)  # -> ListA, ListB
item_10 = ListItem(List=flatten(merge_2), Index=0, Wrap=False)
item_11 = ListItem(List=flatten(merge_2), Index=1, Wrap=False)
item_12 = ListItem(List=flatten(merge_2), Index=0, Wrap=False)
sort_3 = SortList(Keys=dist_3)  # -> Keys, ValuesA
dispatch_8 = Dispatch(List=deplane_3.YAxis, DispatchPattern=equals_4.Equality)  # -> ListA, ListB
merge_3 = Merge(Data1=dispatch_8.ListA, Data2=dispatch_7.ListA)
line_3 = LineSDL(Start=deplane_3.Origin, Direction=merge_3, Length=merge_3)
end_3 = EndPoints(Curve=line_3)  # -> Start, End
srf_cp = SurfaceClosestPoint(Point=end_3.End, Surface=shape_2)  # -> Point, UVPoint, Distance
eval_6 = Evaluate(F="Fn_max*(dist_max-dist)/dist_max", Fn_max=merge_2, dist=dist_2, dist_max=item_9)
item_13 = ListItem(List=sort_3.Keys, Index=-1, Wrap=True)
smaller_3 = SmallerThan(FirstNumber=srf_cp.Distance, SecondNumber=0.001)  # -> SmallerThan, OrEqualTo
tstat_3 = TreeStatistics(Tree=eval_6)  # -> Paths, Length, Count
dispatch_9 = Dispatch(List=merge_3, DispatchPattern=smaller_3.SmallerThan)  # -> ListA, ListB
eval_7 = Evaluate(F="Fn_max*(dist_max-dist)/dist_max", Fn_max=merge_2, dist=dist_3, dist_max=item_13)
neg = Negative(Value=dispatch_9.ListA)
item_14 = ListItem(List=distributions_2, Index=0, Wrap=False)
item_15 = ListItem(List=distributions_2, Index=1, Wrap=False)
item_16 = ListItem(List=distributions_2, Index=2, Wrap=False)
merge_4 = Merge(Data1=neg, Data2=dispatch_9.ListB)
item_17 = ListItem(List=tstat_3.Paths, Index=0, Wrap=True)
item_18 = ListItem(List=tstat_3.Paths, Index=1, Wrap=True)
item_19 = ListItem(List=tstat_3.Paths, Index=2, Wrap=True)
item_20 = ListItem(List=flatten(merge_2), Index=0, Wrap=False)
item_21 = ListItem(List=flatten(merge_2), Index=1, Wrap=False)
item_22 = ListItem(List=flatten(merge_2), Index=0, Wrap=False)
branch_5 = TreeBranch(Tree=eval_6, Path=item_17, MaintainPaths=True)
lng = ListLength(List=branch_5)
dup = DuplicateData(Data=item_12, Number=lng, Order=True)
filter = StreamFilter(Gate=item_14, Stream0=branch_5, Stream1=dup)
branch_6 = TreeBranch(Tree=eval_6, Path=item_18, MaintainPaths=True)
lng_2 = ListLength(List=branch_6)
dup_2 = DuplicateData(Data=item_11, Number=lng_2, Order=True)
filter_2 = StreamFilter(Gate=item_15, Stream0=branch_6, Stream1=dup_2)
branch_7 = TreeBranch(Tree=eval_6, Path=item_19, MaintainPaths=True)
lng_3 = ListLength(List=branch_7)
dup_3 = DuplicateData(Data=item_10, Number=lng_3, Order=True)
filter_3 = StreamFilter(Gate=item_16, Stream0=branch_7, Stream1=dup_3)
merge_5 = Merge(Data1=filter, Data2=filter_2, Data3=filter_3)
tstat_4 = TreeStatistics(Tree=eval_7)  # -> Paths, Length, Count
srf_cp_2 = SurfaceClosestPoint(Point=end_2.End, Surface=shape_2)  # -> Point, UVPoint, Distance
line_4 = LineSDL(Start=deplane_3.Origin, Direction=merge_4, Length=merge_5)
smaller_4 = SmallerThan(FirstNumber=srf_cp_2.Distance, SecondNumber=0.001)  # -> SmallerThan, OrEqualTo
item_23 = ListItem(List=distributions_2, Index=0, Wrap=False)
item_24 = ListItem(List=distributions_2, Index=1, Wrap=False)
item_25 = ListItem(List=distributions_2, Index=2, Wrap=False)
vec = Vector(line_4)
and_2 = GateAnd(A=A, B=graft(normal_forces_2))
dispatch_10 = Dispatch(List=deplane_2.XAxis, DispatchPattern=smaller_4.SmallerThan)  # -> ListA, ListB
move_2 = Move(Geometry=deplane_3.Origin, Motion=line_4)  # -> Geometry, Transform
neg_2 = Negative(Value=vec)
item_26 = ListItem(List=tstat_4.Paths, Index=0, Wrap=True)
item_27 = ListItem(List=tstat_4.Paths, Index=1, Wrap=True)
item_28 = ListItem(List=tstat_4.Paths, Index=2, Wrap=True)
neg_3 = Negative(Value=dispatch_10.ListB)
branch_8 = TreeBranch(Tree=eval_7, Path=item_26, MaintainPaths=True)
lng_4 = ListLength(List=branch_8)
dup_4 = DuplicateData(Data=item_22, Number=lng_4, Order=True)
filter_4 = StreamFilter(Gate=item_23, Stream0=branch_8, Stream1=dup_4)
branch_9 = TreeBranch(Tree=eval_7, Path=item_27, MaintainPaths=True)
lng_5 = ListLength(List=branch_9)
dup_5 = DuplicateData(Data=item_21, Number=lng_5, Order=True)
filter_5 = StreamFilter(Gate=item_24, Stream0=branch_9, Stream1=dup_5)
branch_10 = TreeBranch(Tree=eval_7, Path=item_28, MaintainPaths=True)
lng_6 = ListLength(List=branch_10)
dup_6 = DuplicateData(Data=item_20, Number=lng_6, Order=True)
filter_6 = StreamFilter(Gate=item_25, Stream0=branch_10, Stream1=dup_6)
dispatch_11 = Dispatch(List=move_2.Geometry, DispatchPattern=and_2)  # -> ListA, ListB
merge_6 = Merge(Data1=dispatch_10.ListA, Data2=neg_3)
merge_7 = Merge(Data1=filter_4, Data2=filter_5, Data3=filter_6)
vdis_2 = VectorDisplay(Anchor=dispatch_11.ListA, Vector=neg_2)
multiplication_4 = Multiplication(A=merge_6, B=merge_7)
vlen = VectorLength(Vector=multiplication_4)
sort_4 = SortList(Keys=vlen)  # -> Keys, ValuesA
item_29 = ListItem(List=sort_4.Keys, Index=-1, Wrap=True)
division_2 = Division(A=multiplication_4, B=item_29)
dispatch_12 = Dispatch(List=division_2, DispatchPattern=graft(normal_forces_2))  # -> ListA, ListB
multiplication_5 = Multiplication(A=dispatch_12.ListB, B=0)
addition = Addition(A=[dispatch_12.ListA, multiplication_5], B=[dispatch_6.ListA, multiplication_3])
vlen_2 = VectorLength(Vector=addition)
sort_5 = SortList(Keys=vlen_2)  # -> Keys, ValuesA
item_30 = ListItem(List=sort_5.Keys, Index=-1, Wrap=True)
division_3 = Division(A=addition, B=item_30)
devec_3 = DeconstructVector(Vector=division_3)  # -> flatten(XComponent), flatten(YComponent), ZComponent
lng_7 = ListLength(List=devec_3.XComponent)
lng_8 = ListLength(List=devec_3.YComponent)
division_4 = Division(A=devec_3.YComponent, B=lng_8)
division_5 = Division(A=devec_3.XComponent, B=lng_7)
R = ClusterOutput(division_5)
R_2 = ClusterOutput(division_4)
