# Grasshopper definition learn1.gh (Grasshopper 1.0.7)

divlength = DivideLength(Curve=<geometry referenced from the Rhino model>, Length=Slider(10.066, range=0.5..20))  # -> Points, Tangents, Parameters
divide = DivideCurve(Curve=<geometry referenced from the Rhino model>, Count=Slider(11, range=1..100), Kinks=False)  # -> Points, Tangents, Parameters
pull = PullPoint(Point=divlength.Points, Geometry=<curve referenced from the Rhino model>, ClosestOnly=True)  # -> ClosestPoint, Distance
pull_2 = PullPoint(Point=divlength.Points, Geometry=<curve referenced from the Rhino model>, ClosestOnly=True)  # -> ClosestPoint, Distance
arc = Arc3Pt(PointA=pull_2.ClosestPoint, PointB=divlength.Points, PointC=pull.ClosestPoint)  # -> Arc, Plane, Radius
